# Grasshopper definition ply-cleanmesh-python-grasshopper.gh (Grasshopper 1.0.8)
# plug-ins: RhinoCodePluginGH

path = FilePath("H:\.shortcut-targets-by-id\1P94_FriH-renU_epDTwjgoBKafB7-HZN\Mosqueteros\SOFTWARE\WORKING FILES\RHINO GRASSHOPPER\ply_files\capture02_24_16_11.ply")

# ----
# README: #  Ball Pivoting & Mesh Closing Algorithm
# ##  Description
# This component reconstructs a **mesh from a point cloud (.PLY)** using **Ball Pivoting Algorithm (BPA)**
# and closes gaps by detecting open edges and refining the mesh.
# ✔ Auto-fixes normals
# ✔ Removes duplicate points
# ✔ Closes gaps & refines mesh
# ✔ Outputs a **continuous, closed surface**
# 
# ---
# ##  Inputs
#  `filePath` _(string)_ → Full path to `.PLY` file
#  `voxel_size` _(float)_ → Voxel size for downsampling _(0.005 - 0.02)_
# 🔹 `radius_factor` _(float)_ → Ball Pivoting radius _(2.0 - 5.0)_
#  `generate_mesh` _(bool)_ → `True` to create mesh, `False` for point cloud only
# 
# ---
# ##  Outputs
#  `a` → **Point list** (Rhino.Geometry.Point3d)
#  `b` → **Normal vectors** (Rhino.Geometry.Vector3d)
#  `c` → **Final mesh** (Rhino.Geometry.Mesh)
# ---
# 
# ## 📌 Usage Guide
# 1️**Load a `.PLY` file**
# 2️**Adjust `voxel_size` & `radius_factor`**
# 3️ **Set `generate_mesh = True`**
# 4 **Check outputs: `a` (points), `b` (normals), `c` (mesh)**
# 
#  **Recommended Values:**
#  `voxel_size = 0.01`
#  `radius_factor = 3.5`
# 
#  **For best results, adjust parameters if needed!**
# #  Ball Pivoting & Mesh Closing Algorithm
path_2 = FilePath("C:\Users\User\Downloads\25-02-2025 (1)\25-02-2025.ply")
py3 = Python3Script(filePath=path, generate_mesh=Toggle(True), voxel_size=Slider(0.01, range=0..0.1), radius_factor=Slider(1, range=0..1))  # -> out, a, b, c; inputs filePath: String, generate_mesh: Boolean, voxel_size: Double, radius_factor: Double
#   port generate_mesh: False: Displays only the point cloud. True: Generates the Poisson mesh.
#   port voxel_size: Controls point cloud density. Smaller values retain more detail but are slower.0.05, 0.1, 0.2, etc
#   port radius_factor: Controls mesh resolution (higher depth = more detail but slower).8, 10, 12, etc
# ---------- py3: Python ----------
#! python 3
# venv : testOpen3D
# r: open3d
import open3d as o3d

#! python 3
# venv : testNumpy
# r: numpy
import numpy as np

#! python 3
# venv : testScipy
# r: scipy
from scipy.spatial import Delaunay

#! python 3
# venv : testRhino
# r: rhino3dm
import Rhino.Geometry as rg

#! python 3
# venv : testGrasshopper
# r: grasshopper
import Grasshopper as gh

def fix_normals(pcd):
    """ Ensures all normals are correctly oriented outward. """
    centroid = np.mean(np.asarray(pcd.points), axis=0)
    points = np.asarray(pcd.points)
    normals = np.asarray(pcd.normals)

    for i in range(len(points)):
        vec_to_center = centroid - points[i]
        vec_to_center /= np.linalg.norm(vec_to_center)  

        dot_product = np.dot(vec_to_center, normals[i])
        
        if dot_product < 0:  
            normals[i] = -normals[i]

    pcd.normals = o3d.utility.Vector3dVector(normals)
    return pcd

def remove_duplicates(pcd):
    """ Removes duplicate points from the point cloud using NumPy. """
    unique_points, indices = np.unique(np.asarray(pcd.points), axis=0, return_index=True)
    unique_pcd = o3d.geometry.PointCloud()
    unique_pcd.points = o3d.utility.Vector3dVector(unique_points)

    if pcd.has_normals():
        unique_normals = np.asarray(pcd.normals)[indices]
        unique_pcd.normals = o3d.utility.Vector3dVector(unique_normals)

    return unique_pcd

def compute_ball_pivoting(pcd, radius_factor):
    """ Generates a mesh using the Ball Pivoting Algorithm (BPA). """
    try:
        pcd.estimate_normals(search_param=o3d.geometry.KDTreeSearchParamHybrid(radius=2, max_nn=30))

        # Compute radius for BPA
        distances = pcd.compute_nearest_neighbor_distance()
        avg_dist = np.mean(distances)
        ball_radius = avg_dist * radius_factor

        # Ball Pivoting Algorithm (BPA)
        bpa_mesh = o3d.geometry.TriangleMesh.create_from_point_cloud_ball_pivoting(
            pcd, o3d.utility.DoubleVector([ball_radius, ball_radius * 1.5, ball_radius * 2])
        )

        return bpa_mesh

    except RuntimeError as e:
        print(f"❌ Error in Ball Pivoting Algorithm: {e}")
        return None

def fill_open_edges(mesh):
    """ Closes open edges by adding faces with areas similar to the mesh average. """
    if mesh is None:
        return None

    print("🔍 Detecting open edges...")
    edge_map = {}
    triangles = np.asarray(mesh.triangles)
    vertices = np.asarray(mesh.vertices)

    # Identificar bordes abiertos
    for tri in triangles:
        edges = [(tri[i], tri[(i+1)%3]) for i in range(3)]
        for edge in edges:
            edge = tuple(sorted(edge))
            if edge in edge_map:
                edge_map[edge] += 1
            else:
                edge_map[edge] = 1

    open_edges = [edge for edge, count in edge_map.items() if count == 1]

    if len(open_edges) == 0:
        print("✅ No open edges detected.")
        return mesh

    print(f"⚠️ Found {len(open_edges)} open edges, attempting to close...")

    # Calcular el área media de los triángulos
    def triangle_area(a, b, c):
        return 0.5 * np.linalg.norm(np.cross(b - a, c - a))

    existing_areas = [triangle_area(vertices[t[0]], vertices[t[1]], vertices[t[2]]) for t in triangles]
    mean_area = np.mean(existing_areas)

    new_triangles = []

    for edge in open_edges:
        p1, p2 = vertices[edge[0]], vertices[edge[1]]

        # Buscar el tercer punto más cercano para cerrar la cara
        distances = np.linalg.norm(vertices - (p1 + p2) / 2, axis=1)
        nearest_idx = np.argmin(distances)
        
        if nearest_idx in edge:
            continue  # Evitar agregar el mismo punto
        
        p3 = vertices[nearest_idx]
        area = triangle_area(p1, p2, p3)

        # Agregar solo si el área es cercana a la media
        if 0.5 * mean_area < area < 2.0 * mean_area:
            new_triangles.append([edge[0], edge[1], nearest_idx])

    if len(new_triangles) == 0:
        print("⚠️ No valid triangles generated to close gaps.")
        return mesh

    print(f"✅ Added {len(new_triangles)} new triangles to close open edges.")

    # Añadir nuevas caras a la malla
    new_triangles = np.array(new_triangles, dtype=np.int32)
    mesh.triangles = o3d.utility.Vector3iVector(np.vstack((triangles, new_triangles)))

    return mesh

# Validate file path
filePath = filePath if isinstance(filePath, str) and filePath.endswith(".ply") else None

if filePath and isinstance(voxel_size, (float, int)) and isinstance(radius_factor, (float, int)):
    try:
        print(f"📂 Loading point cloud: {filePath}")
        pcd = o3d.io.read_point_cloud(filePath)

        # Downsample and remove duplicates
        pcd_down = pcd.voxel_down_sample(voxel_size=max(0.01, voxel_size))
        pcd_down = remove_duplicates(pcd_down)
        
        # Estimate and fix normals
        print("📊 Estimating and fixing normals...")
        pcd_down.estimate_normals(search_param=o3d.geometry.KDTreeSearchParamHybrid(radius=2, max_nn=30))
        pcd_down = fix_normals(pcd_down)

        rhino_mesh = None  

        # Generate BPA mesh if requested
        if generate_mesh:
            try:
                print(f"⚙️ Running Ball Pivoting Algorithm (radius factor = {radius_factor})...")
                mesh_o3d = compute_ball_pivoting(pcd_down, radius_factor)

                # Fill open edges with new triangles
                mesh_o3d = fill_open_edges(mesh_o3d)

                # Convert Open3D mesh to Rhino.Geometry.Mesh
                if mesh_o3d is not None:
                    rhino_mesh = rg.Mesh()
                    vertices = np.asarray(mesh_o3d.vertices)
                    triangles = np.asarray(mesh_o3d.triangles)

                    for v in vertices:
                        rhino_mesh.Vertices.Add(v[0], v[1], v[2])
                    for tri in triangles:
                        rhino_mesh.Faces.AddFace(int(tri[0]), int(tri[1]), int(tri[2]))

                    rhino_mesh.Normals.ComputeNormals()

            except Exception as e:
                print("❌ Error in Ball Pivoting Mesh Generation:", e)

        # Grasshopper Outputs
        a = [rg.Point3d(pt[0], pt[1], pt[2]) for pt in np.asarray(pcd_down.points)]
        b = [rg.Vector3d(n[0], n[1], n[2]) for n in np.asarray(pcd_down.normals)]
        c = rhino_mesh

    except Exception as e:
        a, b, c = None, None, None
        print("❌ Processing error:", e)
# ---------- end py3 ----------
vdis = VectorDisplay(Anchor=py3.a, Vector=expr("X/100", py3.b))
mesh = Mesh(py3.c)
pt = Point(py3.a)
panel = Panel(py3.out)
preview = CustomPreview(Geometry=mesh, Material=ColourSwatch(SwatchColor=RGBA(97, 97, 97, 142)))

# ----
# README: # Alpha Shape Mesh Reconstruction
# ## Description
# This component reconstructs a mesh from a point cloud (.PLY) using the Alpha Shape Algorithm.
# It first estimates normals, fixes orientation, and triangulates the shape based on the `alpha` parameter.
# 
# - Auto-fixes normals
# - Removes duplicate points
# - Creates a closed surface
# - Best for organic & detailed shapes
# 
# ---
# 
# ## Inputs
# - `filePath` (string): Full path to `.PLY` file
# - `voxel_size` (float): Voxel size for downsampling (0.005 - 0.02)
# - `alpha` (float): Alpha Shape threshold (1.0 - 5.0) (Higher = smoother surface)
# - `generate_mesh` (bool): `True` to create mesh, `False` for point cloud only
# 
# ---
# 
# ## Outputs
# - `a`: Point list (Rhino.Geometry.Point3d)
# - `b`: Normal vectors (Rhino.Geometry.Vector3d)
# - `c`: Final mesh (Rhino.Geometry.Mesh)
# 
# ---
# 
# ## Usage Guide
# 1. Load a `.PLY` file
# 2. Adjust `voxel_size` & `alpha`
# 3. Set `generate_mesh = True`
# 4. Check outputs: `a` (points), `b` (normals), `c` (mesh)
# 
# Recommended Values:
# - `voxel_size = 0.01`
# - `alpha = 3.0`
# 
# For best results, adjust parameters if needed.
number_slider = Slider(0.01, range=0..0.1)
path_3 = FilePath("C:\Users\User\Downloads\25-02-2025 (1)\25-02-2025.ply")
py3_2 = Python3Script(filePath=path_3, generate_mesh=Toggle(True), voxel_size=number_slider, alpha=Slider(0.04, range=0..1))  # -> out, a, b, c; inputs filePath: String, generate_mesh: Boolean, voxel_size: Double, alpha: Double
#   port generate_mesh: False: Displays only the point cloud. True: Generates the Poisson mesh.
#   port voxel_size: Controls point cloud density. Smaller values retain more detail but are slower.0.05, 0.1, 0.2, etc
#   port alpha: Controls mesh resolution (higher depth = more detail but slower).8, 10, 12, etc
# ---------- py3_2: Python ----------
#! python 3
# venv : testOpen3D
# r: open3d
import open3d as o3d

#! python 3
# venv : testNumpy
# r: numpy
import numpy as np

#! python 3
# venv : testRhino
# r: rhino3dm
import Rhino.Geometry as rg

#! python 3
# venv : testGrasshopper
# r: grasshopper
import Grasshopper as gh

def fix_normals(pcd):
    """
    Ensures all normals are correctly oriented outward.
    This is done by flipping normals that are pointing inward.
    """
    centroid = np.mean(np.asarray(pcd.points), axis=0)
    points = np.asarray(pcd.points)
    normals = np.asarray(pcd.normals)

    for i in range(len(points)):
        vec_to_center = centroid - points[i]
        vec_to_center /= np.linalg.norm(vec_to_center)  

        dot_product = np.dot(vec_to_center, normals[i])
        
        if dot_product < 0:  
            normals[i] = -normals[i]

    pcd.normals = o3d.utility.Vector3dVector(normals)
    return pcd

def compute_alpha_shape(point_cloud, alpha):
    """
    Uses Open3D's Alpha Shape to generate a mesh.
    """
    try:
        alpha_mesh = o3d.geometry.TriangleMesh.create_from_point_cloud_alpha_shape(point_cloud, alpha)
        return alpha_mesh
    except Exception as e:
        print(f"❌ Error in Alpha Shape Reconstruction: {e}")
        return None

# Validate file path
filePath = filePath if isinstance(filePath, str) and filePath.endswith(".ply") else None

if filePath and isinstance(voxel_size, (float, int)) and isinstance(alpha, (float, int)):
    try:
        # 1. Load point cloud from .PLY file
        pcd = o3d.io.read_point_cloud(filePath)

        # 2. Downsample the point cloud with a user-defined voxel size
        pcd_down = pcd.voxel_down_sample(voxel_size=max(0.01, voxel_size)) 
        
        # 3. Estimate normals
        pcd_down.estimate_normals(search_param=o3d.geometry.KDTreeSearchParamHybrid(radius=2, max_nn=30))

        # 4. Fix normal orientations
        pcd_down = fix_normals(pcd_down)

        # Convert to NumPy arrays for analysis
        pts_np = np.asarray(pcd_down.points)
        normals_np = np.asarray(pcd_down.normals)

        # Convert to Rhino objects
        rhino_points = [rg.Point3d(pt[0], pt[1], pt[2]) for pt in pts_np]
        rhino_normals = [rg.Vector3d(n[0], n[1], n[2]) for n in normals_np]

        rhino_mesh = None  

        # 5. Generate Alpha Shape mesh if requested
        if generate_mesh:
            try:
                mesh_o3d = compute_alpha_shape(pcd_down, alpha)

                # 6. Crop the mesh using the bounding box
                if mesh_o3d is not None:
                    bbox = pcd_down.get_axis_aligned_bounding_box()
                    mesh_o3d = mesh_o3d.crop(bbox)

                # 7. Convert Open3D mesh to Rhino.Geometry.Mesh
                if mesh_o3d is not None:
                    vertices = np.asarray(mesh_o3d.vertices)
                    triangles = np.asarray(mesh_o3d.triangles)
                    rhino_mesh = rg.Mesh()

                    for v in vertices:
                        rhino_mesh.Vertices.Add(v[0], v[1], v[2])
                    for tri in triangles:
                        rhino_mesh.Faces.AddFace(int(tri[0]), int(tri[1]), int(tri[2]))

                    rhino_mesh.Normals.ComputeNormals()

            except Exception as e:
                print("❌ Error in Alpha Shape Mesh Generation:", e)

        # Grasshopper Outputs
        a = rhino_points   
        b = rhino_normals  
        c = rhino_mesh     

    except Exception as e:
        a, b, c = None, None, None
        print("❌ Processing error:", e)

else:
    a = "❌ Provide a valid filePath and correct parameters."
    b, c = None, None
# ---------- end py3_2 ----------
panel_2 = Panel("alpha shape")
vdis_2 = VectorDisplay(Anchor=py3_2.a, Vector=expr("x/100", py3_2.b))
mesh_2 = Mesh(py3_2.c)
pt_2 = Point(py3_2.a)
panel_3 = Panel(py3_2.out)
preview_2 = CustomPreview(Geometry=mesh_2, Material=ColourSwatch(SwatchColor=RGBA(97, 97, 97, 142)))

# ----
# # Poisson Surface Reconstruction
# ## Description
# This component reconstructs a mesh from a **point cloud (.PLY)** using the **Poisson Surface Reconstruction Algorithm**.
# It first **estimates normals**, **fixes their orientation**, and then generates a smooth, closed mesh.
# 
# - Auto-fixes normals
# - Removes duplicate points
# - Generates a smooth, closed surface
# - Best for reconstructing organic & watertight meshes
# 
# ---
# 
# ## Inputs
# - `filePath` (string): Full path to `.PLY` file
# - `voxel_size` (float): Voxel size for downsampling (0.005 - 0.02)
# - `poisson_depth` (int): Poisson reconstruction depth (6 - 12) (Higher = more detail)
# - `generate_mesh` (bool): `True` to create mesh, `False` for point cloud only
# 
# ---
# 
# ## Outputs
# - `a`: Point list (Rhino.Geometry.Point3d)
# - `b`: Normal vectors (Rhino.Geometry.Vector3d)
# - `c`: Final mesh (Rhino.Geometry.Mesh)
# 
# ---
# 
# ## Usage Guide
# 1. Load a `.PLY` file
# 2. Adjust `voxel_size` & `poisson_depth`
# 3. Set `generate_mesh = True`
# 4. Check outputs: `a` (points), `b` (normals), `c` (mesh)
# 
# Recommended Values:
# - `voxel_size = 0.01`
# - `poisson_depth = 8`
# 
# For best results, adjust parameters if needed.
number_slider_2 = Slider(13, range=0..100)
path_4 = FilePath("C:\Users\User\Downloads\25-02-2025 (1)\25-02-2025.ply")
py3_3 = Python3Script(filePath=path_4, generate_mesh=Toggle(True), voxel_size=Slider(0.01, range=0..0.1), poisson_depth=number_slider_2)  # -> out, a, b, c; inputs filePath: String, generate_mesh: Boolean, voxel_size: Double, poisson_depth: Int32
#   port generate_mesh: False: Displays only the point cloud. True: Generates the Poisson mesh.
#   port voxel_size: Controls point cloud density. Smaller values retain more detail but are slower.0.05, 0.1, 0.2, etc
#   port poisson_depth: Controls mesh resolution (higher depth = more detail but slower).8, 10, 12, etc
# ---------- py3_3: Python ----------
#! python 3
# venv : testOpen3D
# r: open3d
import open3d as o3d

#! python 3
# venv : testNumpy
# r: numpy
import numpy as np

#! python 3
# venv : testRhino
# r: rhino3dm
import Rhino.Geometry as rg

#! python 3
# venv : testGrasshopper
# r: grasshopper
import Grasshopper as gh

def fix_normals(pcd):
    """
    Ensures all normals are correctly oriented outward.
    This is done by flipping normals that are pointing inward.
    """
    centroid = np.mean(np.asarray(pcd.points), axis=0)
    points = np.asarray(pcd.points)
    normals = np.asarray(pcd.normals)

    for i in range(len(points)):
        vec_to_center = centroid - points[i]
        vec_to_center /= np.linalg.norm(vec_to_center)  

        dot_product = np.dot(vec_to_center, normals[i])
        
        if dot_product < 0:  
            normals[i] = -normals[i]

    pcd.normals = o3d.utility.Vector3dVector(normals)
    return pcd

# Validate file path
filePath = filePath if isinstance(filePath, str) and filePath.endswith(".ply") else None

if filePath and isinstance(voxel_size, (float, int)) and isinstance(poisson_depth, int):
    try:
        print(f"📂 Loading point cloud: {filePath}")
        pcd = o3d.io.read_point_cloud(filePath)

        # 2. Downsample the point cloud with a user-defined voxel size
        pcd_down = pcd.voxel_down_sample(voxel_size=max(0.01, voxel_size))  

        # 3. Estimate normals
        print("📊 Estimating and fixing normals...")
        pcd_down.estimate_normals(search_param=o3d.geometry.KDTreeSearchParamHybrid(radius=2, max_nn=30))
        pcd_down = fix_normals(pcd_down)  # Fixing normal orientation

        # Convert points and normals to NumPy arrays
        pts_np = np.asarray(pcd_down.points)
        normals_np = np.asarray(pcd_down.normals)

        # Convert to Rhino objects
        rhino_points = [rg.Point3d(pt[0], pt[1], pt[2]) for pt in pts_np]
        rhino_normals = [rg.Vector3d(n[0], n[1], n[2]) for n in normals_np]

        rhino_mesh = None  

        # 4. Generate Poisson Mesh if requested
        if generate_mesh:
            try:
                print(f"⚙️ Running Poisson Surface Reconstruction (depth={poisson_depth})...")
                mesh_o3d, densities = o3d.geometry.TriangleMesh.create_from_point_cloud_poisson(pcd_down, depth=poisson_depth)

                # 5. Crop mesh using bounding box
                if mesh_o3d is not None:
                    bbox = pcd_down.get_axis_aligned_bounding_box()
                    mesh_o3d = mesh_o3d.crop(bbox)

                # 6. Convert Open3D mesh to Rhino.Geometry.Mesh
                if mesh_o3d is not None:
                    vertices = np.asarray(mesh_o3d.vertices)
                    triangles = np.asarray(mesh_o3d.triangles)
                    rhino_mesh = rg.Mesh()

                    for v in vertices:
                        rhino_mesh.Vertices.Add(v[0], v[1], v[2])
                    for tri in triangles:
                        rhino_mesh.Faces.AddFace(int(tri[0]), int(tri[1]), int(tri[2]))

                    rhino_mesh.Normals.ComputeNormals()

            except Exception as e:
                print("❌ Error in Poisson Surface Reconstruction:", e)

        # Grasshopper Outputs
        a = rhino_points   # List of Rhino.Geometry.Point3d
        b = rhino_normals  # List of Rhino.Geometry.Vector3d
        c = rhino_mesh     # Generated Poisson mesh (if generate_mesh=True)

    except Exception as e:
        a, b, c = None, None, None
        print("❌ Processing error:", e)

else:
    a = "❌ Provide a valid filePath and correct parameters."
    b, c = None, None
# ---------- end py3_3 ----------
panel_4 = Panel(" Poisson Mesh Processor")
panel_5 = Panel(py3_3.out)
vdis_3 = VectorDisplay(Anchor=py3_3.a, Vector=expr("x/100", py3_3.b))
pt_3 = Point(py3_3.a)
mesh_3 = Mesh(py3_3.c)
preview_3 = CustomPreview(Geometry=mesh_3, Material=ColourSwatch(SwatchColor=RGBA(97, 97, 97, 142)))
